# Grasshopper definition Massing Area Analysis.gh (Grasshopper 1.0.7)

# ---- group: Inputs
floor_to_floor_height = Panel("""20
10
10
10
12
15
10
10
12
15
12
12""")
# Description: This Grasshopper file contours a given massing geometry or a collotion of geimetries based on list of floor to floor heights and outputs areas,floor heights, etc., as well as floor plan boundaries and massing blucks.
massings = Brep([<brep referenced from the Rhino model> x4])
min_cieling_height = Panel("8")

# ---- group: Removing extra elevations and moving the planes to the floor elevations
xy = XYPlane(Origin=Point(0, 0, 0))
ma = MassAddition(Input=floor_to_floor_height)  # -> Result, PartialResults
massings_2 = Brep(massings)
floor_elevations = Number(ma.PartialResults)
bbox = BoundingBox(Content=massings_2, Plane=PlaneXY(0, 0, 0), UnionBox=True)  # -> Box, Box_2
debox = DeconstructBox(Box=bbox.Box)  # -> Plane, X, Y, Z
dedomain = DeconstructDomain(Domain=debox.Z)  # -> Start, End
smaller = SmallerThan(FirstNumber=floor_elevations, SecondNumber=dedomain.End)  # -> SmallerThan, OrEqualTo
cull = CullPattern(List=floor_elevations, CullPattern=smaller.SmallerThan)
Z = UnitZ(Factor=cull)
move = Move(Geometry=xy, Motion=Z)  # -> Geometry, Transform

# ----
cull_2 = CullPattern(List=floor_to_floor_height, CullPattern=smaller.SmallerThan)

# ---- group: Creating Top and Bottom Contour Lines
# You'll get an error if there is a plane with no intersection with a brep. You can ignore this error.
min_cieling_height_2 = Number(min_cieling_height)
ins = InsertItems(List=move.Geometry, Item=xy, Indices="0", Wrap=True)
Z_2 = UnitZ(Factor=min_cieling_height_2)
massings_3 = Brep(massings)
move_2 = Move(Geometry=ins, Motion=Z_2)  # -> Geometry, Transform
sec = BrepPlane(Brep=graft(massings_3), Plane=move_2.Geometry)  # -> Curves, Points

# ---- group: Remove Nulls
clean = CleanTree(RemoveNulls=True, RemoveInvalid=True, RemoveEmpty=True, Tree=sec.Curves)  # -> flatten(Tree)

# ---- group: Arrange the contours based on level
area = Area(Geometry=clean)  # -> Area, Centroid
pdecon = Deconstruct(Point=area.Centroid)  # -> XComponent, YComponent, ZComponent
cset = CreateSet(List=pdecon.ZComponent)  # -> Set, Map
sort = SortList(Keys=cset.Set)  # -> Keys, ValuesA
similar = Similarity(FirstNumber=graft(sort.Keys), SecondNumber=pdecon.ZComponent, Threshold=Slider(0.001, range=0..0.001))  # -> Similarity, AbsoluteDifference
cull_3 = CullPattern(List=clean, CullPattern=similar.Similarity)

# ---- group: Merge the contours and calcualte the areas and heghts
min_cieling_height_3 = Number(min_cieling_height)
Z_3 = UnitZ(Factor=min_cieling_height_3)
move_3 = Move(Geometry=cull_3, Motion=expr("-x", Z_3))  # -> Geometry, Transform
runion = RegionUnion(Curves=move_3.Geometry)
area_2 = Area(Geometry=runion)  # -> Area, Centroid

# ---- group: Creating Massing Blucks
num = Number(cull_2)
ceilng_boundaries = Curve(runion)
Z_4 = UnitZ(Factor=num)
extr = Extrude(Base=ceilng_boundaries, Direction=graft(Z_4))
cap = CapHoles(Brep=extr)

# ---- group: Data Arraingment
tstat = TreeStatistics(Tree=runion)  # -> Paths, Length, Count
pdecon_2 = Deconstruct(Point=area_2.Centroid)  # -> XComponent, YComponent, ZComponent
item = ListItem(List=pdecon_2.ZComponent, Index=0, Wrap=True)  # -> flatten(Item)
num_2 = Number(tstat.Count)
series = Series(Start=expr("1", 0), Step=1, Count=num_2)
item_2 = ListItem(List=reverse(sort.Keys), Index=0, Wrap=True)
ma_2 = MassAddition(Input=flatten(area_2.Area))  # -> Result, PartialResults
ma_3 = MassAddition(Input=area_2.Area)  # -> flatten(Result), PartialResults
round = Round(Number=ma_3.Result)  # -> Nearest, Floor, Ceiling
round_2 = Round(Number=ma_2.Result)  # -> Nearest, Floor, Ceiling
floor_count = Integer(series)
max_building_height = Number(item_2)
floor_to_floor_heights = Number(num)
floor_elevations_2 = Number(item)
total_area = Number(round_2.Nearest)
areas_per_floor = Number(round.Nearest)

# ---- group: Geometry
floor_boundaries = Curve(ceilng_boundaries)
massing_divided = Brep(cap)

# ----
areas_per_floor_2 = Number(areas_per_floor)
total_area_2 = Number(total_area)
floor_elevations_3 = Number(floor_elevations_2)
max_building_height_2 = Number(max_building_height)
floor_to_floor_heights_2 = Number(floor_to_floor_heights)
floor_count_2 = Integer(floor_count)

# ---- group: Outputs
floor_count_3 = Panel(floor_count_2)
max_building_height_3 = Panel(max_building_height_2)
floor_elevations_4 = Panel(floor_elevations_3)
floor_to_floor_heights_3 = Panel(floor_to_floor_heights_2)
total_area_3 = Panel(total_area_2)
areas_per_floor_3 = Panel(areas_per_floor_2)
